vi "ASKRx_AM.gvi"   [LabVIEW Communications System Design Software 2.0.1]
panel controls:
  "IQ rate": f64 = 1000000
  "carrier frequency": f64 = 915000000
  "gain (dB)": f64
  "active antenna": string = "RX2"
  "message length (bits)": f64 = 1000
  "symbol rate (sym/s)": f64 = 10000
  "Device names": string
  "pulse shaping filter": T1 = "none"
panel indicators:
  "actual IQ rate": f64
  "actual carrier frequency": f64
  "actual gain (dB)": f64
  "error out": error
  "Output bits": i32[]
  "BER": f64
  "trigger found?": bool
  "Baseband Output": cluster{"t0": f64, "dt": f64, "Y": f64[]}
  "Eye Diagram_pluse align output": cluster{"t0": f64, "dt": f64, "Y": f64[]}[]
  "Eye Diagram_2": cluster{"t0": f64, "dt": f64, "Y": f64[]}[]
  "Baseband Output_2 (Raw)": f64[]
types:
  T1 = enum{"none", "Raised Cosine", "Root Raised Cos", "Gaussian"}
uses:
  NI::Analysis::Operations::1D Convolution (DBL).gvi
  NI::Analysis::Resampling::Decimate (single shot, CDB).gvi
diagram:
  call "niUSRP Open Rx Session.gvi"(niUSRP Device=$"Device names") -> (error out=w1, session handle out=w2)
  call "niUSRP Configure Signal.gvi"(session handle=w2, IQ rate=$"IQ rate", carrier frequency=$"carrier frequency", gain=$"gain (dB)", error in (no error)=w1, active antenna=$"active antenna") -> (session handle out=w3, coerced IQ rate=w4, coerced carrier frequency=w5, coerced gain=w6, Error Out=w7)
  call "niUSRP Initiate.gvi"(session handle=w3, error in (no error)=w7) -> (session handle out=w8, Error Out=w9)
  # no. samples
  # samples/symbol
  Divide(x=w4, y=$"symbol rate (sym/s)") -> w10
  Multiply($"message length (bits)", w10) -> w11
  Multiply(2, w11) -> w12
  To Quad Integer(number=w12) -> w13
  call "niUSRP Fetch Rx Data (CDB Cluster).gvi"(session handle=w8, number of samples=w13, error in (no error)=w9) -> (session handle out=w14, data=w15, Error Out=w16)
  Property Node(instance in=w15) -> ("dt"=w17, "Y"=w18, "dt"=w19)
  To Long Integer(number=w10) -> w20
  call "MT Generate Filter Coefficients.gvi"(pulse shaping filter=$"pulse shaping filter", matched samples per symbol=w20, modulation type="ASK") -> (matched filter coefficients=w21)
  Reciprocal(x=w19) -> w22
  call "Chebyshev Filter (CDB).gvi"(filter type="Bandpass", X=w18, sampling freq: fs=w22, high cutoff freq: fh=110000, low cutoff freq: fl=90000) -> (Filtered X=w23)
  Complex To Real Imaginary(x + iy=w23) -> (x=w24)
  Absolute Value(x=w24) -> w25
  call "1D Convolution (DBL).gvi"(x=w25, y=w21) -> (x * y=w26)
  w27 = cluster{"t0": f64, "dt": f64, "Y": f64[]} {all zero or empty}
  Property Node(instance in=w27, "dt"=w17, "Y"=w26) -> (instance out=w28)  # Cluster Properties
  $"Baseband Output" <- w28
  call "niUSRP Abort.gvi"(Handle in=w14, error in (no error)=w16) -> (Handle out=w29, Error Out=w30)
  call "niUSRP Close Session.gvi"(handle in=w29, error in=w30) -> (error out=w31)
  call "Simple Error Handler.gvi"(error in=w31) -> (error out=w32)
  $"error out" <- w32
  Property Node(instance in=w28) -> ("Y"=w33)  # Cluster Properties
  $"Baseband Output_2 (Raw)" <- w33
  $"actual IQ rate" <- w4
  To Long Integer(number=w10) -> w34
  call "PulseAlign(real).gvi"(Input Signal=w28, Receiver Sampling Factor=w34) -> (Aligned Signal=w35)
  call "MT Format Eye Diagram (complex).gvi"(waveform=w35, symbol rate=$"symbol rate (sym/s)", eye length=2) -> (eye diagram=w36)
  # Daha net olacak. Çünkü pulse align sonrası
  $"Eye Diagram_pluse align output" <- w36
  $"actual carrier frequency" <- w5
  $"actual gain (dB)" <- w6
  # 2.
  call "MT Format Eye Diagram (complex).gvi"(waveform=w28, symbol rate=$"symbol rate (sym/s)", eye length=2) -> (eye diagram=w37)
  $"Eye Diagram_2" <- w37
  To Long Integer(number=$"message length (bits)") -> w38
  call "Decimate (single shot, CDB).gvi"(decimating factor=w34) -> (decimated array=w39)
  Complex To Real Imaginary(x + iy=w39) -> (x=w40)  # Complex to Real and Imaginary
  call "FrameSync(Real).gvi"(Sampled Input=w40, Receiver Sampling Factor=w10) -> (Aligned Samples=w41)
  # threshold
  call "Mean DBL.gvi"(X=w41) -> (mean=w42)
  Is Greater(x=w41, y=w42) -> w43  # Greater?
  Boolean To Integer(Boolean=w43) -> (0, 1=w44)
  Array Subset(array=w44, index0=0, length0=w38) -> w45
  To Long Integer(number=w45) -> w46
  $"Output bits" <- w46
  To Byte Integer(number=w45) -> w47
  # BER
  call "MT Calculate BER After Trigger (Fibonacci PN Sequence).gvi"(input bit stream=w47, BER trigger threshold=0.4) -> (BER=w48, trigger found?=w49)
  $BER <- w48
  $"trigger found?" <- w49
