vi "ASKTxTemplate.gvi"   [LabVIEW Communications System Design Software 2.0.1]
panel controls:
  "IQ rate": f64 = 200000
  "carrier frequency": f64 = 915100000
  "gain (dB)": f64
  "active antenna": string = "TX1"
  "message length (bits)": i32 = 1000
  "symbol rate (sym/s)": i32 = 10000
  "stop": bool
  "Device names": "niUSRPClass"
  "pulse shaping filter": T2 = "none"
  "niUSRP Device": "niUSRPClass"
panel indicators:
  "actual IQ rate": f64
  "actual carrier frequency": f64
  "actual gain (dB)": f64
  "error out": error
  "Baseband Waveform": waveform<c128>
  "source bit stream": i8[]
  "Power Spectrum": T1
types:
  T1 = cluster{"f0": f64, "df": f64, "magnitude": f64[]}
  T2 = enum{"none", "Raised Cosine", "Root Raised Cos", "Gaussian"}
uses:
  NI::Analysis::Resampling::Upsample (CDB).gvi
  NI::Analysis::Operations::1D Convolution (CDB).gvi
diagram:
  call "niUSRP Open Tx Session.gvi"(Device names=$"Device names") -> (session handle out=w1, Error Out=w2)
  call "niUSRP Configure Signal.gvi"(session handle=w1, IQ rate=$"IQ rate", carrier frequency=$"carrier frequency", gain=$"gain (dB)", error in (no error)=w2, active antenna=$"active antenna") -> (session handle out=w3, coerced IQ rate=w4, coerced carrier frequency=w5, coerced gain=w6, Error Out=w7)
  # Symbol Mapping
  Divide(x=w4, y=$"symbol rate (sym/s)") -> w8
  call "MT Generate Bits (Fibonacci, PN Order).gvi"(total bits=$"message length (bits)", error in=w7) -> (output bit stream=w9)
  To Double Precision Float(number=w9) -> w10
  Multiply(w10, 2) -> w11
  Decrement(x=w11) -> w12
  call "AddFrameHeader(Real).gvi"(Array in=w12) -> (Array out=w13)
  Real And Imaginary To Complex(x=w13, y=0) -> w14
  call "Upsample (CDB).gvi"(input array=w14, upsampling factor=w8) -> (upsampled array=w15)
  # Upsampling
  # Pulse Shaping
  call "MT Generate Filter Coefficients.gvi"(pulse shaping filter=$"pulse shaping filter", pulse shaping samples per symbol=w8, modulation type="ASK") -> (pulse shaping filter coefficients=w16)
  call "1D Convolution (CDB).gvi"(x=w15, y=w16) -> (x * y=w17)
  Absolute Value(x=w17) -> w18
  call "Quick Scale 1D.gvi"(X=w18) -> (max|X|=w19)
  Divide(x=w17, y=w19) -> w20
  Decrement(x=w20) -> w21
  Divide(x=w21, y=2) -> w22
  while {
    call "niUSRP Write Tx Data (CDB).gvi"(session handle=w3, data=w22, end of data?=$stop) -> (session handle out=w23, Error Out=w24)
    Logical Or(w24, $stop) -> w25
    stop if w25
  }
  call "niUSRP Close Session.gvi"(handle in=w23, error in=w24) -> (error out=w26)
  call "Simple Error Handler.gvi"(error in=w26) -> (error out=w27)
  $"error out" <- w27
  $"actual IQ rate" <- w4
  $"actual carrier frequency" <- w5
  $"actual gain (dB)" <- w6
  call "AddFrameHeader(Complex).gvi"()
  $"source bit stream" <- w9
  # Modulation
  Reciprocal(x=w4) -> w28
  w29 = cluster{"t0": timestamp, "dt": f64, "Y": c128[]} {all zero or empty}
  Property Node(instance in=w29, "Y"=w22, "dt"=w28) -> (instance out=w30)
  call "FFT Power Spectrum for 1 Chan (CDB)2.gvi"(time signal=w30) -> (power spectrum=w31)
  $"Power Spectrum" <- w31
  Build Waveform Node(Y=w22, dt=w28) -> (output waveform=w32)
  $"Baseband Waveform" <- w32
