vi "ASKTx_AM.gvi"   [LabVIEW Communications System Design Software 2.0.1]
panel controls:
  "IQ rate": f64 = 200000
  "carrier frequency": f64 = 915100000
  "gain (dB)": f64
  "active antenna": string = "TX1"
  "message length (bits)": i32 = -24
  "symbol rate (sym/s)": f64 = 10000
  "stop": bool
  "Device names": string
  "pulse shaping filter": T2 = "none"
panel indicators:
  "actual IQ rate": f64
  "actual carrier frequency": f64
  "actual gain (dB)": f64
  "error out": error
  "Baseband Waveform": waveform<c128>
  "source bit stream": i8[]
  "Power Spectrum": T1
  "error indicator for MT": error
types:
  T1 = cluster{"f0": f64, "df": f64, "magnitude": f64[]}
  T2 = enum{"none", "Raised Cosine", "Root Raised Cos", "Gaussian"}
uses:
  NI::Analysis::Resampling::Upsample (DBL).gvi
  NI::Analysis::Operations::1D Convolution (CDB).gvi
diagram:
  call "niUSRP Open Tx Session.gvi"(Device names=$"Device names") -> (session handle out=w1, Error Out=w2)
  call "niUSRP Configure Signal.gvi"(session handle=w1, IQ rate=$"IQ rate", carrier frequency=$"carrier frequency", gain=$"gain (dB)", error in (no error)=w2, active antenna=$"active antenna") -> (session handle out=w3, coerced IQ rate=w4, coerced carrier frequency=w5, coerced gain=w6, Error Out=w7)
  Divide(x=w4, y=$"symbol rate (sym/s)") -> w8
  To Long Integer(number=w8) -> w9
  call "MT Generate Bits (Fibonacci, PN Order).gvi"(total bits=$"message length (bits)", PN sequence order=10, error in=w7, reset?=FALSE) -> (output bit stream=w10, error out=w11)
  # Symbol Mapping
  for {
    w12 = each element of w10
    Is Not Equal To 0(x=w12) -> w14
    Select(s=w14, t=1, f=-1) -> w15
    Real And Imaginary To Complex(x=w15, y=0) -> w16
    append w16 to w13
  }
  Complex To Real Imaginary(x + iy=w13) -> (x=w17)
  call "AddFrameHeader(Real).gvi"(Array in=w17) -> (Array out=w18)
  call "Upsample (DBL).gvi"(input array=w18, upsampling factor=w9) -> (upsampled array=w19)
  # Upsampling
  To Long Integer(number=w8) -> w20
  call "MT Generate Filter Coefficients.gvi"(pulse shaping filter=$"pulse shaping filter", matched samples per symbol=w20, modulation type="ASK") -> (pulse shaping filter coefficients=w21)
  # Pulse Shaping
  To Double Precision Complex(number=w21) -> w22
  call "1D Convolution (CDB).gvi"(x=w19, y=w22) -> (x * y=w23)
  Complex To Real Imaginary(x + iy=w23) -> (x=w24)
  # Modulation
  call "Quick Scale 1D.gvi"(X=w24) -> (max|X|=w25)
  Math Node("X"=w23, "M"=w25) -> ("G"=w26)
  ~~~
  A = X / M;
  G = (1 + A) * 0.5;
  ~~~
  while {
    call "niUSRP Write Tx Data (CDB).gvi"(session handle=w3, data=w26, end of data?=$stop) -> (session handle out=w27, Error Out=w28)
    Logical Or(w28, $stop) -> w29
    stop if w29
  }
  call "niUSRP Close Session.gvi"(handle in=w27, error in=w28) -> (error out=w30)
  call "Simple Error Handler.gvi"(error in=w30) -> (error out=w31)
  $"error out" <- w31
  $"actual IQ rate" <- w4
  $"actual carrier frequency" <- w5
  $"actual gain (dB)" <- w6
  $"source bit stream" <- w10
  $"error indicator for MT" <- w11
  Reciprocal(x=w4) -> w32
  w33 = cluster{"t0": timestamp, "dt": f64, "Y": c128[]} {all zero or empty}
  Property Node(instance in=w33, "Y"=w26, "dt"=w32) -> (instance out=w34)  # Cluster Properties
  call "FFT Power Spectrum for 1 Chan (CDB)2.gvi"(time signal=w34) -> (power spectrum=w35)
  $"Power Spectrum" <- w35
  Build Waveform Node(Y=w26, dt=w32) -> (output waveform=w36)
  $"Baseband Waveform" <- w36
