vi "AMSubcarrier_2.gvi"   [LabVIEW Communications System Design Software 2.0.1]
inputs:
  "Message Waveform": waveform<f64> = {dt=1, Y=[]}
  "Modulation index": f64 = 1
  "Carrier Level (A)": f64
  "subcarrier frequency": f64 = 10
  "sample rate": f64 = 1000
  "samples": i32 = 1000
  "subcarrier amplitude": f64 = 1
outputs:
  "Modulated Signal Out": c128[]
  "Output Graph": waveform<c128>[]
uses:
  NI::Analysis::Generation::Sine Waveform.gvi
diagram:
  Property Node(instance in=$"Message Waveform") -> ("Y"=w1)
  call "Quick Scale 1D.gvi"(X=w1) -> (max|X|=w2)
  Math Node("mp"=w2, "m"=w1, "mu"=$"Modulation index", "A"=$"Carrier Level (A)") -> ("E"=w3)  # MathScript Node
  ~~~
  E = A * (1 + (mu * (m / mp)));
  ~~~
  $"Modulated Signal Out" <- w3
  call "Sine Waveform.gvi"(amplitude=$"subcarrier amplitude", frequency=$"subcarrier frequency", phase in=90, sample rate=$"sample rate", samples=$samples) -> (sine wave=w4)
  Property Node(instance in=w4) -> (instance out=w5)
  Waveform Multiply(w3, w5) -> w6
  $"Output Graph" <- w6
