vi "AMSubcarrier_3.gvi"   [LabVIEW Communications System Design Software 2.0.1]
inputs:
  "modulation index": f64
  "carrier level": f64 = 1
  "subcarrier frequency": f64 = 10
  "sample rate": f64 = 1000
  "message waveform": waveform<f64> = {dt=1, Y=[]}
  "samples": i32 = 1000
outputs:
  "Numeric Array Output": f64[]
  "message waveform_2": waveform<f64>[]
uses:
  NI::Analysis::Generation::Sine Waveform.gvi
diagram:
  Property Node(instance in=$"message waveform") -> ("Y"=w1)
  call "Quick Scale 1D.gvi"(X=w1) -> (max|X|=w2)
  Math Node("mp"=w2, "m"=w1, "mu"=$"modulation index", "A"=$"carrier level") -> ("E"=w3)
  ~~~
  A=1;
  E = A*[1 + mu*(m/mp)];
  ~~~
  $"Numeric Array Output" <- w3
  call "Sine Waveform.gvi"(frequency=$"subcarrier frequency", phase in=90, sample rate=$"sample rate", samples=$samples) -> (sine wave=w4)
  Property Node(instance in=w4) -> (instance out=w5)
  Waveform Multiply(w3, w5) -> w6
  $"message waveform_2" <- w6
