vi "Lab3Rx_Updated.gvi"   [LabVIEW Communications System Design Software 2.0.1]
panel controls:
  "IQ rate": f64 = 2000000
  "carrier frequency": f64 = 915000000
  "gain (dB)": f64
  "active antenna": string = "RX2"
  "number of samples": i64 = 200000
  "stop": bool
  "niUSRP Device": "niUSRPClass"
panel indicators:
  "actual IQ rate": f64
  "actual carrier frequency": f64
  "actual gain (dB)": f64
  "error out": error
  "Message 2 out": waveform<f64>
  "Message 1 out": waveform<f64>
  "Power 2": f64
  "Power 1": f64
  "Power Spectrum": T1
types:
  T1 = cluster{"f0": f64, "df": f64, "magnitude": f64[]}
uses:
  NI::Analysis::Filtering::Chebyshev Bandpass Filter (CDB).gvi
  NI::Analysis::Filtering::Butterworth Lowpass Filter (DBL).gvi
  NI::Analysis::Measurement::Power Spectrum for 1 Chan (CDB).gvi
diagram:
  call "niUSRP Open Rx Session.gvi"(niUSRP Device=$"niUSRP Device") -> (error out=w1, session handle out=w2)
  call "niUSRP Configure Signal.gvi"(session handle=w2, IQ rate=$"IQ rate", carrier frequency=$"carrier frequency", gain=$"gain (dB)", error in (no error)=w1, active antenna=$"active antenna") -> (session handle out=w3, coerced IQ rate=w4, coerced carrier frequency=w5, coerced gain=w6, Error Out=w7)
  call "niUSRP Initiate.gvi"(session handle=w3, error in (no error)=w7) -> (session handle out=w8, Error Out=w9)
  while (after w4) {
    call "niUSRP Fetch Rx Data (CDB WDT).gvi"(session handle=w8, number of samples=$"number of samples", error in (no error)=w9) -> (session handle out=w10, data=w11, Error Out=w12)
    Property Node(instance in=w11) -> ("Y"=w13, "dt"=w14)
    Is First Call() -> w15
    Not(x=w15) -> w16
    call "Chebyshev Bandpass Filter (CDB).gvi"(signal=w13, sampling frequency=w4, high cutoff frequency=0.45, low cutoff frequency=0.125, passband ripple=0.1, order=5, reset=w16) -> (filtered signal=w17)
    Complex To Real Imaginary(x + iy=w17) -> (x=w18)
    Absolute Value(x=w18) -> w19
    call "Butterworth Lowpass Filter (DBL).gvi"(signal=w19, cutoff frequency=0.125, order=2) -> (filtered signal=w20)
    call "AC & DC Estimator.gvi"(Signal (V)=w20) -> (AC estimate (Vrms)=w21)
    $"Power 1" <- w21
    Logical Or(w12, $stop) -> w22
    Build Waveform Node(Y=w20, dt=w14) -> (output waveform=w23)
    $"Message 1 out" <- w23
    call "Power Spectrum for 1 Chan (CDB).gvi"(signal=w11, dB on=TRUE) -> (power spectrum=w24)
    $"Power Spectrum" <- w24
    Property Node(instance in=w11) -> ("Y"=w25, "dt"=w26)
    Is First Call() -> w27
    Not(x=w27) -> w28
    call "Chebyshev Bandpass Filter (CDB).gvi"(signal=w25, sampling frequency=4, high cutoff frequency=0.45, low cutoff frequency=0.125, passband ripple=0.1, order=5, reset=w28) -> (filtered signal=w29)
    Complex To Real Imaginary(x + iy=w29) -> (x=w30)
    Absolute Value(x=w30) -> w31
    call "Butterworth Lowpass Filter (DBL).gvi"(signal=w31, cutoff frequency=0.125, order=2) -> (filtered signal=w32)
    call "AC & DC Estimator.gvi"(Signal (V)=w32) -> (AC estimate (Vrms)=w33)
    $"Power 2" <- w33
    Build Waveform Node(Y=w32, dt=w26) -> (output waveform=w34)
    $"Message 2 out" <- w34
    stop if w22
  }
  call "niUSRP Abort.gvi"(Handle in=w10, error in (no error)=w12) -> (Handle out=w35, Error Out=w36)
  call "niUSRP Close Session.gvi"(handle in=w35, error in=w36) -> (error out=w37)
  call "Simple Error Handler.gvi"(error in=w37) -> (error out=w38)
  $"error out" <- w38
  $"actual IQ rate" <- w4
  $"actual carrier frequency" <- w5
  $"actual gain (dB)" <- w6
