vi "MuxRx_AM.gvi"   [LabVIEW Communications System Design Software 2.0.1]
panel controls:
  "IQ rate": f64 = 2000000
  "carrier frequency": f64 = 915000000
  "gain (dB)": f64
  "active antenna": string = "RX2"
  "number of samples": i64 = 200000
  "stop": bool
  "niUSRP Device": "niUSRPClass"
panel indicators:
  "actual IQ rate": f64
  "actual carrier frequency": f64
  "actual gain (dB)": f64
  "error out": error
  "Message 2 out": waveform<f64>
  "Message 1 out": waveform<f64>
  "Power 2": f64
  "Power 1": f64
  "Power Spectrum": T1
types:
  T1 = cluster{"f0": f64, "df": f64, "magnitude": f64[]}
uses:
  NI::Analysis::Filtering::Chebyshev Bandpass Filter (CDB).gvi
  NI::Analysis::Filtering::Butterworth Lowpass Filter (DBL).gvi
  NI::Analysis::Measurement::Power Spectrum for 1 Chan (CDB).gvi
diagram:
  call "niUSRP Open Rx Session.gvi"(niUSRP Device=$"niUSRP Device") -> (error out=w1, session handle out=w2)
  call "niUSRP Configure Signal.gvi"(session handle=w2, IQ rate=$"IQ rate", carrier frequency=$"carrier frequency", gain=$"gain (dB)", error in (no error)=w1, active antenna=$"active antenna") -> (session handle out=w3, coerced IQ rate=w4, coerced carrier frequency=w5, coerced gain=w6, Error Out=w7)
  call "niUSRP Initiate.gvi"(session handle=w3, error in (no error)=w7) -> (session handle out=w8, Error Out=w9)
  while (after w4) {
    Reciprocal(x=w4) -> w10
    call "niUSRP Fetch Rx Data (CDB WDT).gvi"(session handle=w8, number of samples=$"number of samples", error in (no error)=w9) -> (session handle out=w11, data=w12, Error Out=w13)
    Property Node(instance in=w12) -> ("Y"=w14, "dt"=w15)
    call "Chebyshev Bandpass Filter (CDB).gvi"(signal=w14, sampling frequency=w10, high cutoff frequency=505000, low cutoff frequency=495000, passband ripple=0.1, order=5) -> (filtered signal=w16)
    Complex To Real Imaginary(x + iy=w16) -> (x=w17)
    Absolute Value(x=w17) -> w18
    call "Butterworth Lowpass Filter (DBL).gvi"(signal=w18, cutoff frequency=0.125, order=2) -> (filtered signal=w19)
    call "AC & DC Estimator.gvi"(Signal (V)=w19) -> (AC estimate (Vrms)=w20)
    $"Power 1" <- w20
    Logical Or(w13, $stop) -> w21
    Build Waveform Node(Y=w19, dt=w15) -> (output waveform=w22)
    $"Message 1 out" <- w22
    call "Power Spectrum for 1 Chan (CDB).gvi"(signal=w12, dB on=TRUE) -> (power spectrum=w23)
    $"Power Spectrum" <- w23
    Property Node(instance in=w12) -> ("Y"=w24, "dt"=w25)
    call "Chebyshev Bandpass Filter (CDB).gvi"(signal=w24, sampling frequency=1, high cutoff frequency=515000, low cutoff frequency=505000, passband ripple=0.1, order=5) -> (filtered signal=w26)
    Complex To Real Imaginary(x + iy=w26) -> (x=w27)
    Absolute Value(x=w27) -> w28
    call "Butterworth Lowpass Filter (DBL).gvi"(signal=w28, cutoff frequency=0.125, order=2) -> (filtered signal=w29)
    call "AC & DC Estimator.gvi"(Signal (V)=w29) -> (AC estimate (Vrms)=w30)
    $"Power 2" <- w30
    Build Waveform Node(Y=w29, dt=w25) -> (output waveform=w31)
    $"Message 2 out" <- w31
    stop if w21
  }
  call "niUSRP Abort.gvi"(Handle in=w11, error in (no error)=w13) -> (Handle out=w32, Error Out=w33)
  call "niUSRP Close Session.gvi"(handle in=w32, error in=w33) -> (error out=w34)
  call "Simple Error Handler.gvi"(error in=w34) -> (error out=w35)
  $"error out" <- w35
  $"actual IQ rate" <- w4
  $"actual carrier frequency" <- w5
  $"actual gain (dB)" <- w6
