vi "MuxTx_AM.gvi"   [LabVIEW Communications System Design Software 2.0.1]
panel controls:
  "IQ rate": f64 = 2000000
  "carrier frequency": f64 = 915000000
  "gain (dB)": f64
  "active antenna": string = "TX1"
  "message length (samples)": f64 = 200000
  "start frequency 1": f64 = 100
  "delta frequency 1": f64 = 100
  "#tones 1": i32 = 3
  "Modulation index 1": f64 = 1
  "Subcarrier frequency 1": f64 = 500000
  "start frequency 2": f64 = 1000
  "delta frequency 2": f64 = 1000
  "#tones 2": i32 = 3
  "Modulation index 2": f64 = 1
  "Subcarrier frequency 2": f64 = 510000
  "stop": bool
  "Device names": "niUSRPClass"
panel indicators:
  "actual IQ rate": f64
  "actual carrier frequency": f64
  "actual gain (dB)": f64
  "error out": error
  "Unmodulated Message": waveform<f64>[]
  "Baseband Signal": f64[]
diagram:
  call "niUSRP Open Tx Session.gvi"(Device names=$"Device names") -> (session handle out=w1, Error Out=w2)
  call "niUSRP Configure Signal.gvi"(session handle=w1, IQ rate=$"IQ rate", carrier frequency=$"carrier frequency", gain=$"gain (dB)", error in (no error)=w2, active antenna=$"active antenna") -> (session handle out=w3, coerced IQ rate=w4, coerced carrier frequency=w5, coerced gain=w6, Error Out=w7)
  Property Node(instance in=cluster{"Fs": f64, "#s": f64} {"Fs"=1000, "#s"=1000}, "#s"=$"message length (samples)", "Fs"=w4) -> (instance out=w8)
  w9 = TRUE  # coerce frequencies
  call "Basic Multitone.gvi"(phase relationship="random", start frequency=$"start frequency 1", delta frequency=$"delta frequency 1", #tones=$"#tones 1", amplitude=1, sampling info=w8, coerce frequencies?=w9) -> (signal out=w10)
  w11 = 1  # carrier level 1
  call "AMSubcarrier_3.gvi"(modulation index=$"Modulation index 1", carrier level=w11, subcarrier frequency=$"Subcarrier frequency 1", message waveform=w10) -> (Numeric Array Output=w12)
  w13 = FALSE  # coerce frequencies
  call "Basic Multitone.gvi"(phase relationship="random", start frequency=$"start frequency 2", delta frequency=$"delta frequency 2", #tones=$"#tones 2", amplitude=1, sampling info=w8, coerce frequencies?=w13) -> (signal out=w14)
  w15 = 1  # carrier level 2
  call "AMSubcarrier_3.gvi"(modulation index=$"Modulation index 2", carrier level=w15, subcarrier frequency=$"Subcarrier frequency 2", message waveform=w14) -> (Numeric Array Output=w16)
  Add(w12, w16) -> w17
  call "Quick Scale 1D.gvi"(X=w17) -> (Y[i]=X[i]/Max|X|=w18)
  $"Baseband Signal" <- w18
  Array Size(array=w17) -> (size(s)=w19)
  Initialize Array(element=0, size=w19) -> w20
  Real And Imaginary To Complex(x=w18, y=w20) -> w21
  Reciprocal(x=w4) -> w22
  Build Waveform Node(Y=w21, dt=w22) -> (output waveform=w23)
  while {
    call "niUSRP Write Tx Data (CDB).gvi"(session handle=w3, data=w23, end of data?=$stop, error in (no error)=w7) -> (session handle out=w24, Error Out=w25)
    Logical Or(w25, $stop) -> w26
    stop if w26
  }
  call "niUSRP Close Session.gvi"(handle in=w24, error in=w25) -> (error out=w27)
  call "Simple Error Handler.gvi"(error in=w27) -> (error out=w28)
  $"error out" <- w28
  Build Array(w10, w14) -> w29
  $"Unmodulated Message" <- w29
  $"actual IQ rate" <- w4
  $"actual carrier frequency" <- w5
  $"actual gain (dB)" <- w6
