vi "FMRx_AM.gvi"   [LabVIEW Communications System Design Software 2.0.1]
panel controls:
  "IQ rate": f64 = 1000000
  "carrier frequency": f64 = 915000000
  "gain (dB)": f64
  "active antenna": string = "RX2"
  "number of samples": i64 = 200000
  "stop": bool
  "Device names": string
panel indicators:
  "actual IQ rate": f64
  "actual carrier frequency": f64
  "actual gain (dB)": f64
  "error out": error
  "Baseband Output": waveform<f64>
  "Output Spectrum": f64[]
uses:
  NI::Analysis::Conditioning::Unwrap Phase.gvi
  NI::Analysis::Measurement::Power Spectrum (DBL).gvi
diagram:
  call "niUSRP Open Rx Session.gvi"(niUSRP Device=$"Device names") -> (error out=w1, session handle out=w2)
  call "niUSRP Configure Signal.gvi"(session handle=w2, IQ rate=$"IQ rate", carrier frequency=$"carrier frequency", gain=$"gain (dB)", error in (no error)=w1, active antenna=$"active antenna") -> (session handle out=w3, coerced IQ rate=w4, coerced carrier frequency=w5, coerced gain=w6, Error Out=w7)
  call "niUSRP Initiate.gvi"(session handle=w3, error in (no error)=w7) -> (session handle out=w8, Error Out=w9)
  w10 = $"number of samples"
  while {
    call "niUSRP Fetch Rx Data (CDB WDT).gvi"(session handle=w8, number of samples=w10, error in (no error)=w9) -> (session handle out=w11, data=w12, Error Out=w13)
    Property Node(instance in=w12) -> ("Y"=w14, "dt"=w15)
    Complex To Polar(r * e^(i*theta)=w14) -> (theta=w16)
    call "Unwrap Phase.gvi"(input phase=w16) -> (unwrapped phase=w17)
    call "FIR Filter with I.C. (DBL).gvi"(x=w17, FIR coefficients=[1, -1]) -> (filtered x=w18)
    Reciprocal(x=w15) -> w19
    call "Butterworth Filter (DBL).gvi"(X=w18, sampling freq: fs=w19, high cutoff freq: fh=0, low cutoff freq: fl=5000, order=2) -> (Filtered X=w20)
    Build Waveform Node(Y=w20) -> (output waveform=w21)
    $"Baseband Output" <- w21
    Logical Or(w13, $stop) -> w22
    call "Power Spectrum (DBL).gvi"(signal=w21, dt=w15) -> (power spectrum=w23)
    $"Output Spectrum" <- w23
    stop if w22
  }
  call "niUSRP Abort.gvi"(Handle in=w11, error in (no error)=w13) -> (Handle out=w24, Error Out=w25)
  call "niUSRP Close Session.gvi"(handle in=w24, error in=w25) -> (error out=w26)
  call "Simple Error Handler.gvi"(error in=w26) -> (error out=w27)
  $"error out" <- w27
  $"actual IQ rate" <- w4
  $"actual carrier frequency" <- w5
  $"actual gain (dB)" <- w6
