vi "FMTx_AM_1.gvi"   [LabVIEW Communications System Design Software 2.0.1]
panel controls:
  "IQ rate": f64 = 1000000
  "carrier frequency": f64 = 915000000
  "gain (dB)": f64
  "active antenna": string = "TX1"
  "message length (samples)": f64 = 200000
  "start frequency": f64 = 1000
  "delta frequency": f64 = 1000
  "#tones": i32 = 3
  "Peak deviation (Hz)": f64 = 30000
  "stop": bool
  "Device names": string
panel indicators:
  "actual IQ rate": f64
  "actual carrier frequency": f64
  "actual gain (dB)": f64
  "error out": error
  "Message": waveform<f64>
  "Baseband Spectrum": T1
types:
  T1 = cluster{"f0": f64, "df": f64, "magnitude": f64[]}
uses:
  NI::Analysis::Measurement::Power Spectrum for 1 Chan (CDB).gvi
diagram:
  call "niUSRP Open Tx Session.gvi"(Device names=$"Device names") -> (session handle out=w1, Error Out=w2)
  call "niUSRP Configure Signal.gvi"(session handle=w1, IQ rate=$"IQ rate", carrier frequency=$"carrier frequency", gain=$"gain (dB)", error in (no error)=w2, active antenna=$"active antenna") -> (session handle out=w3, coerced IQ rate=w4, coerced carrier frequency=w5, coerced gain=w6, Error Out=w7)
  w8 = TRUE  # coerce frequencies
  Property Node(instance in=cluster{"Fs": f64, "#s": f64} {"Fs"=1000, "#s"=1000}, "Fs"=w4, "#s"=$"message length (samples)") -> (instance out=w9)
  call "Basic Multitone.gvi"(start frequency=$"start frequency", delta frequency=$"delta frequency", #tones=$"#tones", amplitude=1, sampling info=w9, coerce frequencies?=w8) -> (signal out=w10)
  Property Node(instance in=w10) -> ("Y"=w11, "dt"=w12)
  call "Quick Scale 1D.gvi"(X=w11) -> (Y[i]=X[i]/Max|X|=w13)
  Multiply($"Peak deviation (Hz)", PiTimes2) -> w14
  Multiply(w14, w12) -> w15
  while {
    # peak freq. deviation
    call "IIR Filter with I.C. (DBL).gvi"(x=w13, reverse coefficients=[1, -1], forward coefficients=[1]) -> (filtered x=w16)
    Multiply(w15, w16) -> w17
    # Ac
    Polar To Complex(r=0.9, theta=w17) -> (r * e^(i*theta)=w18)
    call "niUSRP Write Tx Data (CDB).gvi"(session handle=w3, data=w18, end of data?=$stop, error in (no error)=w7) -> (session handle out=w19, Error Out=w20)
    Logical Or(w20, $stop) -> w21
    Build Waveform Node(Y=w18, dt=w12) -> (output waveform=w22)
    call "Power Spectrum for 1 Chan (CDB).gvi"(signal=w22) -> (power spectrum=w23)
    $"Baseband Spectrum" <- w23
    stop if w21
  }
  call "niUSRP Close Session.gvi"(handle in=w19, error in=w20) -> (error out=w24)
  call "Simple Error Handler.gvi"(error in=w24) -> (error out=w25)
  $"error out" <- w25
  $"actual IQ rate" <- w4
  $"actual carrier frequency" <- w5
  $"actual gain (dB)" <- w6
  Build Waveform Node(Y=w13, dt=w12) -> (output waveform=w26)
  $Message <- w26
