vi "FMTx_AM_2.gvi"   [LabVIEW Communications System Design Software 2.0.1]
panel controls:
  "IQ rate": f64 = 1000000
  "carrier frequency": f64 = 915000000
  "gain (dB)": f64
  "active antenna": string = "TX1"
  "message length (samples)": f64 = 200000
  "start frequency": f64 = 1000
  "delta frequency": f64 = 1000
  "#tones": i32 = 3
  "Peak deviation (Hz)": f64 = 30000
  "stop": bool
  "message length (samples)_2": f64 = 200000
  "start frequency_2": f64 = 1000
  "delta frequency_2": f64 = 1000
  "#tones_2": i32 = 3
  "Peak deviation (Hz)_2": f64 = 30000
  "Device names": "niUSRPClass"
panel indicators:
  "actual IQ rate": f64
  "actual carrier frequency": f64
  "actual gain (dB)": f64
  "error out": error
  "Message": waveform<f64>
  "Power Spectrum": T1
  "Message_2": waveform<f64>
types:
  T1 = cluster{"f0": f64, "df": f64, "magnitude": f64[]}
uses:
  NI::Analysis::Measurement::FFT Spectrum (Mag-Phase) for 1 Chan (CDB).gvi
diagram:
  w1 = TRUE  # coerce frequencies
  call "niUSRP Open Tx Session.gvi"(Device names=$"Device names") -> (session handle out=w2, Error Out=w3)
  call "niUSRP Configure Signal.gvi"(session handle=w2, IQ rate=$"IQ rate", carrier frequency=$"carrier frequency", gain=$"gain (dB)", error in (no error)=w3, active antenna=$"active antenna") -> (session handle out=w4, coerced IQ rate=w5, coerced carrier frequency=w6, coerced gain=w7, Error Out=w8)
  Property Node(instance in=cluster{"Fs": f64, "#s": f64} {"Fs"=1000, "#s"=1000}, "Fs"=w5, "#s"=$"message length (samples)_2") -> (instance out=w9)
  call "Basic Multitone.gvi"(start frequency=$"start frequency_2", delta frequency=$"delta frequency_2", #tones=$"#tones_2", amplitude=1, sampling info=w9, coerce frequencies?=w1) -> (signal out=w10)
  $Message_2 <- w10
  $"actual IQ rate" <- w5
  w11 = TRUE  # coerce frequencies
  Property Node(instance in=cluster{"Fs": f64, "#s": f64} {"Fs"=1000, "#s"=1000}, "Fs"=w5, "#s"=$"message length (samples)") -> (instance out=w12)
  call "Basic Multitone.gvi"(start frequency=$"start frequency", delta frequency=$"delta frequency", #tones=$"#tones", amplitude=1, sampling info=w12, coerce frequencies?=w11) -> (signal out=w13)
  Property Node(instance in=w13) -> ("dt"=w14)
  Property Node(instance in=w10) -> ("dt"=w15)
  Multiply($"Peak deviation (Hz)_2", PiTimes2) -> w16
  Multiply(w16, w15) -> w17
  Multiply($"Peak deviation (Hz)", PiTimes2) -> w18
  Multiply(w18, w14) -> w19
  while {
    call "IIR Filter with I.C. (DBL).gvi"(x=w13, reverse coefficients=[1, -1], forward coefficients=[1]) -> (filtered x=w20)
    # peak freq. deviation
    Multiply(w19, w20) -> w21
    Polar To Complex(r=0.6, theta=w21) -> (r * e^(i*theta)=w22)
    call "IIR Filter with I.C. (DBL).gvi"(x=w10, reverse coefficients=[1, -1], forward coefficients=[1]) -> (filtered x=w23)
    # peak freq. deviti
    # peak freq. deviation
    Multiply(w17, w23) -> w24
    Polar To Complex(r=0.4, theta=w24) -> (r * e^(i*theta)=w25)
    # Ac
    Add(w25, w22) -> w26
    Build Waveform Node(Y=w26, dt=w14) -> (output waveform=w27)
    call "niUSRP Write Tx Data (CDB).gvi"(session handle=w4, data=w27, end of data?=$stop, error in (no error)=w8) -> (session handle out=w28, Error Out=w29)
    Logical Or(w29, $stop) -> w30
    # Ac
    Build Waveform Node(Y=w22, dt=w14) -> (output waveform=w31)
    call "FFT Spectrum (Mag-Phase) for 1 Chan (CDB).gvi"(signal=w31, window parameter=w14) -> (magnitude=w32)
    $"Power Spectrum" <- w32
    stop if w30
  }
  call "niUSRP Close Session.gvi"(handle in=w28, error in=w29) -> (error out=w33)
  call "Simple Error Handler.gvi"(error in=w33) -> (error out=w34)
  $"error out" <- w34
  $"actual carrier frequency" <- w6
  $Message <- w13
  $"actual gain (dB)" <- w7
